# Grasshopper definition TT_Urbano_Setup_v001.gh (Grasshopper 1.0.7)
# plug-ins: Urbano, Human

download_openstreetmap_osm = DownloadOpenStreetMapOSM(LeftBound="-8.720197", RightBound="-8.690506", TopBound="41.225667", BottomBound="41.199418", RunToggle=True)  # -> OSMQueryURL, OSMFilePath
url = Text(download_openstreetmap_osm.OSMQueryURL)

# ---- group: Cluster Builds Network and Ammentity Buildings
cluster = Cluster(url=download_openstreetmap_osm.OSMQueryURL)  # -> building, street_network

# ---- group: Build the Urban Model
model = BuildUrbanoModel(Buildings=flatten(cluster.building), StreetNetwork=cluster.street_network, BuildToggle=True)  # -> UrbanoModel, BuildingCurves, Activities

# ----
osmstreetnet = ImportOSMStreetNetwork(OSMPathOrURL=url)  # -> StreetNetwork, StreetSegmentCurves, UTMZone, TranslationVector

# ---- group: Run Tripengine
# Input ADP Data
# Click "Build Toggle" to Run !
adper = ActivityDemandProfilePersona(
    LoadADPData="Paris - Weekday (24hr)",
    ColumnIndex=1,
    Normalize=False,
    Persona="""post_office,0,0,0,0,0,0,0,0,0.001,0.003,0.003,0.004,0.005,0.005,0.005,0.005,0.005,0.005,0.004,0.002,0.001,0.001,0,0
bank,0,0,0,0,0,0,0,0,0,0.015,0.026,0.028,0.023,0.013,0.022,0.029,0.026,0.014,0.001,0,0,0,0,0
cinema,0,0,0,0,0,0,0,0,0,0,0,0,0,0.001,0.001,0.001,0.001,0.001,0.001,0.002,0.002,0.002,0.001,0.001
theatre,0,0,0,0,0,0,0,0,0,0,0,0,0.001,0.001,0,0,0,0,0.001,0.002,0.004,0.003,0.001,0
arts_centre,0,0,0,0,0,0,0,0,0,0,0,0.001,0.001,0.001,0.001,0.001,0.001,0.001,0.001,0.001,0.001,0,0,0
pharmacy,0,0,0,0,0,0,0,0,0.007,0.015,0.019,0.022,0.023,0.024,0.026,0.03,0.032,0.032,0.031,0.026,0.011,0.002,0.001,0
restaurant,0,0,0,0,0,0,0,0,0.003,0.003,0.007,0.024,0.128,0.177,0.101,0.021,0.014,0.01,0.024,0.094,0.153,0.156,0.097,0.014
fast_food,0.01,0.006,0,0,0,0,0,0,0.001,0.002,0.004,0.016,0.042,0.051,0.036,0.023,0.017,0.016,0.019,0.025,0.029,0.03,0.025,0.02
cafe,0.004,0.002,0.001,0.001,0,0,0,0.002,0.006,0.012,0.016,0.02,0.03,0.037,0.028,0.021,0.018,0.021,0.027,0.032,0.034,0.029,0.021,0.011
bar,0.009,0.004,0.001,0.001,0,0,0,0.001,0.002,0.003,0.003,0.004,0.009,0.011,0.01,0.007,0.007,0.01,0.018,0.027,0.034,0.034,0.03,0.023
pub,0.009,0.004,0.001,0.001,0,0,0,0.001,0.002,0.003,0.003,0.004,0.009,0.011,0.01,0.007,0.007,0.01,0.018,0.027,0.034,0.034,0.03,0.023
department_store,0,0,0,0,0,0,0,0,0,0,0,0,0.001,0.001,0.001,0.001,0.001,0.001,0.001,0,0,0,0,0
supermarket_store,0,0,0,0,0,0,0,0.001,0.004,0.007,0.011,0.015,0.018,0.019,0.018,0.017,0.019,0.024,0.028,0.026,0.019,0.01,0.005,0.002
convenience_store,0,0,0,0,0,0,0,0,0.001,0.002,0.006,0.01,0.016,0.018,0.016,0.016,0.019,0.02,0.02,0.015,0.012,0.005,0.003,0.001
hardware_store,0,0,0,0,0,0,0,0,0,0.001,0.001,0.001,0.001,0.001,0.001,0.001,0.001,0.001,0,0,0,0,0,0
clothes_store,0,0,0,0,0,0,0,0,0,0.002,0.011,0.017,0.023,0.028,0.032,0.036,0.039,0.043,0.03,0.009,0,0,0,0
books_store,0,0,0,0,0,0,0,0,0,0,0.002,0.003,0.005,0.006,0.005,0.005,0.006,0.006,0.007,0.006,0.002,0.001,0,0
shoes_store,0,0,0,0,0,0,0,0,0,0,0.002,0.003,0.005,0.006,0.006,0.007,0.007,0.007,0.006,0.006,0.005,0.003,0.002,0
beauty_store,0,0,0,0,0,0,0,0,0,0.004,0.014,0.023,0.029,0.03,0.029,0.031,0.033,0.036,0.032,0.015,0,0,0,0""")
adp_trip_engine = ADPTripEngine(
    UrbanoModel=model.UrbanoModel,
    Building=model.BuildingCurves,
    ActivityDemandProfile=adper,
    SingleTravelMode="pedestrian",
    DestinationChoiceModel="nearest",
    BuildToggle=True)

# ----
import_osm_features = ImportOSMFeatures(OSMPathOrURL=url, OSMFeatureType="building", Format="xml", ImportAltitude=False)  # -> Points, Metadata, UTMZone, TranslationVector
pline = PolyLine(Vertices=import_osm_features.Points, Closed=False)
# Select OD locations
bldg = CreateBuilding(BuildingCurve=pline, Metadata=import_osm_features.Metadata)

import_osm_features_2 = ImportOSMFeatures(OSMPathOrURL=url, OSMFeatureType="amenity", Format="xml", ImportAltitude=False)  # -> Points, Metadata, UTMZone, TranslationVector
create_amenity = CreateAmenity(PointLocationOfAmenity=import_osm_features_2.Points, Metadata=import_osm_features_2.Metadata)

# ----
# Routing can be done with just Street Network using
# manually drawn points/curves as origin or destination
pt = Point(Point(1976.256715, 70, 0))
pt_2 = Point(Point(1869.17387, 2682.704376, 0))
router = Router(
    RouterUrbanoModelOrStreetNetwork=osmstreetnet.StreetNetwork,
    Origin=pt,
    Destination=pt_2,
    TravelMode="pedestrian",
    TimeLimit=-1)  # -> Trip, Route, Time, Distance

walkscore_trip_engine = WalkScoreTripEngine()  # -> WalkScoreTrips, WalkScore

arrange_amenities_by_building = ArrangeAmenitiesByBuilding(Amenities=flatten(create_amenity), Buildings=flatten(bldg))  # -> AmenitiesByBuilding, Buildings
create_building = CreateBuilding(BuildingCurve=bldg, Metadata=bldg, AmenitiesInBuilding=arrange_amenities_by_building.AmenitiesByBuilding)

# ---- group: Amenityscore
trip_amenityscore = TripAmenityscore(Trips=flatten(adp_trip_engine))  # -> Amenityscore, Amenity, AmenityHosts
bounds = Bounds(Numbers=trip_amenityscore.Amenityscore)
deconstruct_domain = DeconstructDomain(Domain=bounds)  # -> Start, End
gradient = Gradient(
    LowerLimit=deconstruct_domain.End,
    UpperLimit=deconstruct_domain.Start,
    Parameter=trip_amenityscore.Amenityscore,
    stops=[0: RGB(234, 38, 0), 0.25: RGB(234, 126, 0), 0.5: RGB(254, 244, 84), 0.75: RGB(173, 203, 249), 1: RGB(75, 107, 169)])
custom_preview = CustomPreview(Geometry=trip_amenityscore.AmenityHosts, Material=gradient)

# ---- group: Street Hits / Urban Model
model_2 = UrbanoModel(model.UrbanoModel)

# ----
curve = Curve(router.Route)

# ---- group: Street Hits
# Enable Preview to
# Show StreetHits Gradient
sthits = StreetHits(UrbanoModel=model_2, Trips=flatten(adp_trip_engine))  # -> StreetCurves, StreetHits, StTrips
item = ListItem(List=sthits.StreetCurves, Index=Slider(17, range=0..78), Wrap=True)
insseg = InspectStreetSegment(StreetSegmentCurve=item, UrbanoModel=model_2)  # -> Geometry, Metadata, AdjacentBuildings

# ---- group: Amenity Hits
# Enable Preview to
# Show AmenityHits, Amentyscore and Capacity
amenhits = AmenityHits(Trips=flatten(adp_trip_engine))  # -> Amenity, AmenityHits, AmenityHosts, AmTrips
inamen = InspectAmenity(Amenity=amenhits.Amenity)  # -> Name, Activities, Host, Metadata

# ---- group: Building Hits
# Enable Preview to
# Show BuildingHits Gradient
bldghits = BuildingHits(Trips=flatten(adp_trip_engine))  # -> BuildingCurves, BuildingHits, BuildingTrips
inbldg = InspectBuilding(Building=bldghits.BuildingCurves, DefaultHeight=10)  # -> Geometry, Metadata, Amenity, BuildingMesh

# ----
custom_preview_lineweights = CustomPreviewLineweights(Geometry=curve, Shader=ColourSwatch(SwatchColor=RGB(62, 0, 250)), Thickness="10", Absolute=False)
model_3 = BuildUrbanoModel(Buildings=flatten(create_building), StreetNetwork=osmstreetnet.StreetNetwork, BuildToggle=True)  # -> UrbanoModel, BuildingCurves, Activities

point = Point(<point referenced from the Rhino model>)
data = Data(model_3.BuildingCurves)
point_in_curve = PointInCurve(Point=point, Curve=data)  # -> Relationship, Point
smaller_than = SmallerThan(FirstNumber=point_in_curve.Relationship, SecondNumber=1)  # -> SmallerThan, OrEqualTo
cull_pattern = CullPattern(List=data, CullPattern=invert(smaller_than.SmallerThan))

point_2 = Point(<point referenced from the Rhino model>)
data_2 = Data(model_3.BuildingCurves)
point_in_curve_2 = PointInCurve(Point=point_2, Curve=data_2)  # -> Relationship, Point
smaller_than_2 = SmallerThan(FirstNumber=point_in_curve_2.Relationship, SecondNumber=1)  # -> SmallerThan, OrEqualTo
cull_pattern_2 = CullPattern(List=data_2, CullPattern=invert(smaller_than_2.SmallerThan))

point_3 = Point(<point referenced from the Rhino model>)
data_3 = Data(model_3.BuildingCurves)
point_in_curve_3 = PointInCurve(Point=point_3, Curve=data_3)  # -> Relationship, Point
smaller_than_3 = SmallerThan(FirstNumber=point_in_curve_3.Relationship, SecondNumber=1)  # -> SmallerThan, OrEqualTo
cull_pattern_3 = CullPattern(List=data_3, CullPattern=invert(smaller_than_3.SmallerThan))

# ---- group: Visualze Buildings with Height
inspect_building = InspectBuilding(Building=model_3.BuildingCurves, UrbanoModel=model_3.UrbanoModel, DefaultHeight=10)  # -> Geometry, Metadata, Amenity, BuildingMesh

# ---- group: Visualize Travel Radius
crv = Curve(cull_pattern)
number_slider = Slider(2, range=0..10)
router_2 = Router(
    RouterUrbanoModelOrStreetNetwork=model_3.UrbanoModel,
    Origin=crv,
    Destination=model_3.BuildingCurves,
    TravelMode="pedestrian",
    TimeLimit=-1)  # -> Trip, Route, Time, Distance
travel_time = Panel("15")
smaller_than_4 = SmallerThan(FirstNumber=router_2.Time, SecondNumber=travel_time)  # -> SmallerThan, OrEqualTo
dispatch = Dispatch(List=router_2.Trip, DispatchPattern=smaller_than_4.SmallerThan)  # -> ListA, ListB
intrip = InspectTrip(Trip=dispatch.ListA)  # -> Origin, Destination, Time, Distance, Route, Mode, People, Activity, Amenity
crv_2 = Curve(intrip.Destination)

# ---- group: Routing in Different Modes
crv_3 = Curve(cull_pattern_2)
crv_4 = Curve(cull_pattern_3)
router_3 = Router(
    RouterUrbanoModelOrStreetNetwork=model_3.UrbanoModel,
    Origin=crv_4,
    Destination=crv_3,
    TravelMode="pedestrian",
    TimeLimit=-1)  # -> Trip, Route, Time, Distance
router_4 = Router(RouterUrbanoModelOrStreetNetwork=model_3.UrbanoModel, Origin=crv_4, Destination=crv_3, TravelMode="car", TimeLimit=-1)  # -> Trip, Route, Time, Distance
panel = Panel(router_3.Time)
panel_2 = Panel(router_4.Time)

# ==== cluster Cluster
url = ClusterInput()
# URL / File Path
url_2 = Text(url)

# ---- group: Import Geometries
import_osm_features = ImportOSMFeatures(OSMPathOrURL=url_2, OSMFeatureType="street", Format="xml", ImportAltitude=False)  # -> Points, Metadata, UTMZone, TranslationVector
import_osm_features_2 = ImportOSMFeatures(OSMPathOrURL=url_2, OSMFeatureType="building", Format="xml", ImportAltitude=False)  # -> Points, Metadata, UTMZone, TranslationVector
import_osm_features_3 = ImportOSMFeatures(OSMPathOrURL=url_2, OSMFeatureType="amenity", Format="xml", ImportAltitude=False)  # -> Points, Metadata, UTMZone, TranslationVector

# ---- group: Add Amenity Capacity
lookup_metadata = LookupMetadata(MetadataGeometry=import_osm_features_3.Metadata, SearchKey="amenity")
amenity_capacity = AmenityCapacity(
    Activity=lookup_metadata,
    Area=-1,
    LogisticsAreaProportion=0.2,
    AmenityCapacityData="""post_office, 5, 15
bank, 5, 15
cinema, 1, 248
theatre, 1, 215
arts_centre, 3, 20
department_store, 1, 78
supermarket_store, 2, 32
convenience_store, 1, 39
hardware_store, 1, 50
pharmacy, 1, 42
restaurant, 2, 35
fast_food, 1, 36
cafe, 1, 50
bar, 1, 47
pub, 1, 47
clothes_store, 2, 21
books_store, 1, 26
beauty_store, 1, 27
shoes_store, 1, 38""")
merge_metadata = MergeMetadata(Metadata=amenity_capacity, Metadata_2=import_osm_features_3.Metadata)

# ---- group: Build Basic Model
polyline = PolyLine(Vertices=import_osm_features_2.Points, Closed=False)
polyline_2 = PolyLine(Vertices=import_osm_features.Points, Closed=False)
create_amenity = CreateAmenity(PointLocationOfAmenity=import_osm_features_3.Points, Metadata=merge_metadata)
create_street_network = CreateStreetNetwork(
    StreetCurves=flatten(polyline_2),
    Metadata=flatten(import_osm_features.Metadata),
    SplitStreetCurves=True,
    UTMZone=import_osm_features.UTMZone,
    TranslationVector=import_osm_features.TranslationVector)  # -> StreetNetwork, StreetSegmentCurves, UTMZone, TranslationVector
arrange_amenities_by_building = ArrangeAmenitiesByBuilding(Amenities=flatten(create_amenity), Buildings=flatten(polyline))  # -> AmenitiesByBuilding, Buildings
create_building = CreateBuilding(
    BuildingCurve=arrange_amenities_by_building.Buildings,
    Metadata=import_osm_features_2.Metadata,
    AmenitiesInBuilding=arrange_amenities_by_building.AmenitiesByBuilding)

# ----
street_network = ClusterOutput(create_street_network.StreetNetwork)
building = ClusterOutput(create_building)
