# Grasshopper definition Tutorial_4_Import_GIS.gh (Grasshopper 1.0.7)
# plug-ins: Bifocals, Heron, Human

# ----
# Cropping Boundary
crv = Curve(<curve referenced from the Rhino model>)

# ----
# Cropping Boundary
crv_2 = Curve(<curve referenced from the Rhino model>)

# ----
# Get Raster Map Image from Server
esri_raster = ValueList({"ESRI World Imagery": "https://server.arcgisonline.com/ArcGIS/rest/services/World_Imagery/MapServer/export?", "ESRI World Topo Map": "https://server.arcgisonline.com/arcgis/rest/services/World_Topo_Map/MapServer/export?", "ESRI World Physical Map": "https://server.arcgisonline.com/arcgis/rest/services/World_Physical_Map/MapServer/export?", "ESRI World Street Map": "https://server.arcgisonline.com/arcgis/rest/services/World_Street_Map/MapServer/export?", "ESRI World Terrain Base": "https://server.arcgisonline.com/arcgis/rest/services/World_Terrain_Base/MapServer/export?", "ESRI World Shaded Relief": "https://server.arcgisonline.com/arcgis/rest/services/World_Shaded_Relief/MapServer/export?", "ESRI World Dark Gray Base": "https://server.arcgisonline.com/arcgis/rest/services/Canvas/World_Dark_Gray_Base/MapServer/export?", "ESRI World Light Gray Base": "https://server.arcgisonline.com/arcgis/rest/services/Canvas/World_Light_Gray_Base/MapServer/export?", "ESRI World Hillshade": "https://server.arcgisonline.com/arcgis/rest/services/Elevation/World_Hillshade/MapServer/export?", "ESRI World Hillshade Dark": "https://server.arcgisonline.com/arcgis/rest/services/Elevation/World_Hillshade_Dark/MapServer/export?", "ESRI World Boundaries and Places": "https://server.arcgisonline.com/arcgis/rest/services/Reference/World_Boundaries_and_Places/MapServer/export?", "ESRI World Transportation": "https://server.arcgisonline.com/arcgis/rest/services/Reference/World_Transportation/MapServer/export?", "ESRI DeLorme World Base Map": "https://server.arcgisonline.com/arcgis/rest/services/Specialty/DeLorme_World_Base_Map/MapServer/export?", "ESRI NatGeo World Map": "https://server.arcgisonline.com/arcgis/rest/services/NatGeo_World_Map/MapServer/export?", "ESRI USA Topo Maps": "https://server.arcgisonline.com/arcgis/rest/services/USA_Topo_Maps/MapServer/export?"}, selected="ESRI World Imagery")
where_to_save_the_downloaded_file = Panel("C:\Root\Teaching\Week 4\Assets")
resolution = Panel("2048")
get_rest_raster = GetRESTRaster(
    Boundary=crv_2,
    Resolution=resolution,
    TargetFolder=where_to_save_the_downloaded_file,
    Prefix="restRaster",
    RESTURL=esri_raster,
    ImageType="jpg",
    Run=Toggle(True))  # -> Image, ImageFrame, RESTQuery
url = Panel(get_rest_raster.RESTQuery)

where_to_save_the_downloaded_file_2 = Panel("C:\Root\Teaching\Week 4\Assets")

folder = Panel("C:\Root\Teaching\Week 4\GIS Data\")
file = Panel("nyc building footprints shp\NYC_Building_Footprints.shp")
concatenate = Concatenate(FragmentA=folder, FragmentB=file)

folder_2 = Panel("C:\Root\Teaching\Week 4\GIS Data\")
file_2 = Panel("nyc_mappluto_23v1_1_shp\MapPLUTO.shp")
# Heron v4.1 includes changes to
# component inputs and outputs.
# Script may differ from booklet
# guide.
# Updated Components Marked With:
concatenate_2 = Concatenate(FragmentA=folder_2, FragmentB=file_2)

# ----
# ARCHA4528: DIGITAL TECHNIQUES FOR URBAN DESIGNERS
# TUTORIAL 4 - GIS DATA MODELING
# RICHARD CHOU | hc3039@columbia.edu
# Activate Bifocal
image_resource = ImageResource("F:\My Drive\0_Teaching\DTEQ_2022\00_Planning\DTEQ_logo.png")

# ----
# Cropping Boundary
crv_3 = Curve(<curve referenced from the Rhino model>)

# ----
# Get TopoMesh from DEM from Server
toggle = BooleanToggle(True)
resttopo = GetRESTTopography(Boundary=crv_3, TargetFolder=where_to_save_the_downloaded_file_2, Run=toggle, TopoSource="USGS 3DEP Bare Earth DEM High")  # -> TopoFile, TopoQuery
importtopo = ImportTopo(Boundary=crv_3, TopographyRasterFile=resttopo.TopoFile, Clip=True)  # -> TopographyMesh, TopographyExtent, TopographySourceInfo

# ----
# Cropping Boundary
crv_4 = Curve(<curve referenced from the Rhino model>)

# ----
# Get Raster Map Image from Server
esri_raster_2 = ValueList({"ESRI World Imagery": "https://server.arcgisonline.com/ArcGIS/rest/services/World_Imagery/MapServer/export?", "ESRI World Topo Map": "https://server.arcgisonline.com/arcgis/rest/services/World_Topo_Map/MapServer/export?", "ESRI World Physical Map": "https://server.arcgisonline.com/arcgis/rest/services/World_Physical_Map/MapServer/export?", "ESRI World Street Map": "https://server.arcgisonline.com/arcgis/rest/services/World_Street_Map/MapServer/export?", "ESRI World Terrain Base": "https://server.arcgisonline.com/arcgis/rest/services/World_Terrain_Base/MapServer/export?", "ESRI World Shaded Relief": "https://server.arcgisonline.com/arcgis/rest/services/World_Shaded_Relief/MapServer/export?", "ESRI World Dark Gray Base": "https://server.arcgisonline.com/arcgis/rest/services/Canvas/World_Dark_Gray_Base/MapServer/export?", "ESRI World Light Gray Base": "https://server.arcgisonline.com/arcgis/rest/services/Canvas/World_Light_Gray_Base/MapServer/export?", "ESRI World Hillshade": "https://server.arcgisonline.com/arcgis/rest/services/Elevation/World_Hillshade/MapServer/export?", "ESRI World Hillshade Dark": "https://server.arcgisonline.com/arcgis/rest/services/Elevation/World_Hillshade_Dark/MapServer/export?", "ESRI World Boundaries and Places": "https://server.arcgisonline.com/arcgis/rest/services/Reference/World_Boundaries_and_Places/MapServer/export?", "ESRI World Transportation": "https://server.arcgisonline.com/arcgis/rest/services/Reference/World_Transportation/MapServer/export?", "ESRI DeLorme World Base Map": "https://server.arcgisonline.com/arcgis/rest/services/Specialty/DeLorme_World_Base_Map/MapServer/export?", "ESRI NatGeo World Map": "https://server.arcgisonline.com/arcgis/rest/services/NatGeo_World_Map/MapServer/export?", "ESRI USA Topo Maps": "https://server.arcgisonline.com/arcgis/rest/services/USA_Topo_Maps/MapServer/export?"}, selected="ESRI World Hillshade")
where_to_save_the_downloaded_file_3 = Panel("C:\Root\Teaching\Week 4\Assets")
resolution_2 = Panel("2048")
get_rest_raster_2 = GetRESTRaster(
    Boundary=crv_4,
    Resolution=resolution_2,
    TargetFolder=where_to_save_the_downloaded_file_3,
    Prefix="demo",
    RESTURL=esri_raster_2,
    ImageType="jpg",
    Run=Toggle(True))  # -> Image, ImageFrame, RESTQuery
url_2 = Panel(get_rest_raster_2.RESTQuery)
crv_5 = Curve(get_rest_raster_2.ImageFrame)
image_path = Panel(get_rest_raster_2.Image)

# ----
# Cropping Boundary
crv_6 = Curve(<curve referenced from the Rhino model>)

# ----
# Modeling with GIS Data
path = FilePath(concatenate)
import_vector = ImportVector(Boundary=crv_6, VectorDataLocation=path, ClipIt=True, PointsOnly=False)  # -> DataExtents, Fields, Values, FeatureGeometry
fields = Panel(import_vector.Fields)
geometry = Geometry(import_vector.FeatureGeometry)
mesh_edges = MeshEdges(Mesh=geometry)  # -> NakedEdges, InteriorEdges, NonManifoldEdges
search = Panel("groundelev")
search_2 = Panel("heightroof")
search_3 = Panel("cnstrct_yr")
keysearch = KeyValueSearch(Keys=import_vector.Fields, Values=import_vector.Values, Search=search)  # -> simplify(Result)
keysearch_2 = KeyValueSearch(Keys=import_vector.Fields, Values=import_vector.Values, Search=search_2)  # -> simplify(Result)
keysearch_3 = KeyValueSearch(Keys=import_vector.Fields, Values=import_vector.Values, Search=search_3)  # -> simplify(Result)
join_curves = JoinCurves(Curves=mesh_edges.NakedEdges, Preserve=False)
num = Number(keysearch_3)
path_a = PathA(data=join_curves)
flatten = FlattenTree(Tree=num, Path="{0}")
bnd = Bounds(Numbers=flatten)
crv_7 = Curve(path_a)
multiplication = Multiplication(A=keysearch, B="0.3048")
multiplication_2 = Multiplication(A=keysearch_2, B="0.3048")
panel = Panel(bnd)
Z = UnitZ(Factor=multiplication)
move = Move(Geometry=crv_7, Motion=Z)  # -> Geometry, Transform
dedomain = DeconstructDomain(Domain=panel)  # -> Start, End
boundary = BoundarySurfaces(Edges=move.Geometry)
Z_2 = UnitZ(Factor=multiplication_2)
panel_2 = Panel(dedomain.End)
panel_3 = Panel(dedomain.Start)
extr = Extrude(Base=boundary, Direction=Z_2)
gradient = Gradient(LowerLimit=panel_3, UpperLimit=panel_2, Parameter=num, stops=[0: RGB(207, 0, 0), 1: RGB(10, 55, 168)])
cap = CapHoles(Brep=extr)
preview = CustomPreview(Geometry=cap, Material=gradient)

# ----
# Import Shapefile
path_2 = FilePath(concatenate_2)
# Warning!
curve = Curve(<curve referenced from the Rhino model>)
import_vector_2 = ImportVector(Boundary=curve, VectorDataLocation=path_2, ClipIt=True, PointsOnly=False)  # -> DataExtents, Fields, Values, FeatureGeometry
panel_4 = Panel(import_vector_2.FeatureGeometry)

# ----
# Reconstruct mesh to fix
# texture mapping
demesh = DeconstructMesh(Mesh=importtopo.TopographyMesh)  # -> Vertices, Faces, Colours, Normals
conmesh = ConstructMesh(Vertices=demesh.Vertices, Faces=demesh.Faces)

medges = MeshEdges(Mesh=importtopo.TopographyMesh)  # -> NakedEdges, InteriorEdges, NonManifoldEdges

# ----
# Scale Topo
number_slider = Slider(1.9, range=1..2)
scale_nu = ScaleNU(Geometry=conmesh, Plane=PlaneXY(0, 0, 0), ScaleX=1, ScaleY=1, ScaleZ=number_slider)  # -> Geometry, Transform

# ----
# Map surface image to topo mesh
surfacemap = SurfaceMapping(Mesh=conmesh, Surface=get_rest_raster.ImageFrame)
previewmat = CustomPreviewMaterials(Geometry=surfacemap, DiffuseColor=RGB(255, 255, 255), DiffuseBitmap=get_rest_raster.Image)

attribute_key = Panel(import_vector_2.Fields)
attribute_values = Panel(import_vector_2.Values)

# ----
# Draw Contours
number_slider_2 = Slider(1, range=0..10)
contour = Contour(Shape=scale_nu.Geometry, Point=Point(0, 0, 0), Direction=Vector(0, 0, 1), Distance=number_slider_2)
previewlw = CustomPreviewLineweights(Geometry=contour, Shader=ColourSwatch(SwatchColor=RGB(94, 0, 0)), Absolute=False)

# ----
# Get Vector Map Data from Server
# Load REST Server Data Layer
# List Item index picks
# from the result data layers
# Reads the features from the data layer
index = Panel("1")
esri_american_community_survey = ValueList({"ACS Total Population": "https://services.arcgis.com/P3ePLMYs2RVChkJx/ArcGIS/rest/services/ACS_Total_Population_Boundaries/FeatureServer/", "ACS Household Size": "https://services.arcgis.com/P3ePLMYs2RVChkJx/ArcGIS/rest/services/ACS_Household_Size_Boundaries/FeatureServer/", "ACS Housing Units by Year Built": "https://services.arcgis.com/P3ePLMYs2RVChkJx/ArcGIS/rest/services/ACS_Housing_Units_by_Year_Built_Boundaries/FeatureServer/", "ACS Housing Costs": "https://services.arcgis.com/P3ePLMYs2RVChkJx/ArcGIS/rest/services/ACS_Housing_Costs_Boundaries/FeatureServer/", "ACS Labor Force Participation by Age": "https://services.arcgis.com/P3ePLMYs2RVChkJx/ArcGIS/rest/services/ACS_Labor_Force_Participation_by_Age_Boundaries/FeatureServer/", "ACS Travel Time to Work": "https://services.arcgis.com/P3ePLMYs2RVChkJx/ArcGIS/rest/services/ACS_Travel_Time_to_Work_Boundaries/FeatureServer/"}, selected="ACS Total Population")
restlayer = GetRESTServiceLayers(ServiceURL=esri_american_community_survey)  # -> MapDescription, MapLayers, MapIntegers, MapLayerURLs
description = Panel(restlayer.MapDescription)
layers = Panel(restlayer.MapLayers)
url_3 = Panel(restlayer.MapLayerURLs)
item = ListItem(List=url_3, Index=index, Wrap=True)
url_4 = Panel(item)
get_rest_vector = GetRESTVector(Boundary=crv, RESTURL=url_4, Run=Toggle(True), PointsOnly=False)  # -> FieldNames, FieldValues, FeatureGeometry, RESTQuery
item_2 = ListItem(List=get_rest_vector.FieldValues, Index="7", Wrap=True)

# ----
# This part gets the number domain of the list of values,
# and separate the domain into start and end value.
bnd_2 = Bounds(Numbers=flatten(item_2))
panel_5 = Panel(bnd_2)
dedomain_2 = DeconstructDomain(Domain=bnd_2)  # -> Start, End
panel_6 = Panel(dedomain_2.Start)
panel_7 = Panel(dedomain_2.End)

# ----
# Assign a gradient color based on
# comparing test value to the min/max
gradient_2 = Gradient(
    LowerLimit=panel_6,
    UpperLimit=panel_7,
    Parameter=item_2,
    stops=[0: RGB(250, 249, 217), 0.25: RGB(194, 225, 184), 0.5: RGB(106, 175, 192), 0.75: RGB(63, 95, 166), 1: RGB(36, 35, 88)])

preview_2 = CustomPreview(Geometry=get_rest_vector.FeatureGeometry, Material=gradient_2)

# ==== cluster PathA
data = ClusterInput()

data_2 = Data(simplify(data))
path_mapper = PathMapper(data_2, source=["{A}", "{A;B}", "{A;B;C}"], target=["{A}", "{A}", "{A}"])
data_3 = Data(simplify(path_mapper))

data_4 = ClusterOutput(data_3)
