# Grasshopper definition hops_GetArea.gh (Grasshopper 1.0.7)

get_geometry = GetGeometry(AtLeast=1, AtMost=1, DeleteInput=False, Filter=1074004029, TreeAccess=False)
bounding_box = BoundingBox(Content=get_geometry, Plane=PlaneXY(0, 0, 0))  # -> Box, Box_2
deconstruct_brep = DeconstructBrep(Brep=bounding_box.Box)  # -> Faces, Edges, Vertices
list_item = ListItem(List=deconstruct_brep.Faces, Index=Slider(4, range=0..10), Wrap=True)
list_item_2 = ListItem(List=deconstruct_brep.Faces, Index=Slider(5, range=0..10), Wrap=True)
surface = Surface(list_item)
surface_2 = Surface(list_item_2)
area = Area(Geometry=surface)  # -> Area, Centroid
area_2 = Area(Geometry=surface_2)  # -> Area, Centroid
line = Line(StartPoint=area.Centroid, EndPoint=area_2.Centroid)
divide_distance = DivideDistance(Curve=line, Distance="13")  # -> Points, Tangents, Parameters
mesh_plane = MeshPlane(Mesh=get_geometry, Plane=divide_distance.Points)
brep = Brep(mesh_plane)
area_3 = Area(Geometry=brep)  # -> simplify(Area), Centroid
path_mapper = PathMapper(area_3.Area, source="{a;b}", target="{a}")
mass_addition = MassAddition(Input=path_mapper)  # -> Result, PartialResults
integer = Integer(mass_addition.Result)
panel = Panel(integer)
context_print = ContextPrint(Text=integer)
