# Grasshopper definition GHPython_ReadJSONFILE.gh (Grasshopper 1.0.7)

path = FilePath("C:\Users\PGupta\OneDrive - NBBJ LP\Desktop\Digital\Meta-Urban-Carbon-Hack\data\sampleOutput.json")
json = PythonScript(FilePath=path)  # -> out, buildingData, uniqueIDs, formattedKeys
# ---------- json: Python ----------
import json
import ghpythonlib.treehelpers as gt

if FilePath:
    
    # JSON file to read
    file = open(FilePath)
    
    # Load the data
    data = json.load(file)
    
    # Do something with the data
    
#    print data
keys = list(data['Buildings'][0].keys())
print(keys)

def listBuildingData(buildingData):
    formattedData = [
        buildingData['UniqueID'],
        buildingData['buildingEnergyConsumption'],
        buildingData['operationalCarbonProjection'],
        buildingData['buildingElectricityConsumption'],
        buildingData['buildingNaturalGasConsumption']]

    return formattedData

#print(data["Buildings"])
uniqueIDs = []
buildingDataList = []
for building in data["Buildings"]:
    uniqueID = building['UniqueID']
    uniqueIDs.append(uniqueID)
    buildingData = listBuildingData(building)
    buildingDataList.append(buildingData)

buildingData = gt.list_to_tree(buildingDataList)

formattedKeys = [
        'Unique ID = ',
        'Building Energy Consumption = ',
        'Operational Carbon = ',
        'Electricity Consumption = ',
        'Natural Gas Consumption = ']
# ---------- end json ----------
panel = Panel(json.formattedKeys)
panel_2 = Panel(json.buildingData)
panel_3 = Panel("""9aab22f3-1d4f-499e-b510-87faa513c6db (570)
ba38cd13-aa68-4721-ac64-cf4418838ea2 (599)""")
division = Division()
panel_4 = Panel("\": \"")
concatenate = Concatenate(Fragment_A=json.formattedKeys, A=json.buildingData)
panel_5 = Panel(json.uniqueIDs)
graft_tree = GraftTree(Tree=panel_3, IncludeEmptyLists=True, IncludeNullItems=True)
replace_items = ReplaceItems(List=concatenate, Item=graft_tree, Indices=Slider(0, range=0..100), Wrap=False)
panel_6 = Panel(replace_items)
